# Grasshopper definition threading.gh (Grasshopper 1.0.8)
# plug-ins: RhinoCodePluginGH

c_script = CSharpScript(script=".\demo.cs", maxNumber=Slider(685358, range=10..1000000), nThreads=Slider(12, range=0..16))  # -> out, time
#   port script: Script to execute
# ---------- c_script: C# ----------
// Grasshopper Script Instance
#region Usings
using System;
using System.Linq;
using System.Collections;
using System.Collections.Generic;
using System.Drawing;

using Rhino;
using Rhino.Geometry;

using Grasshopper;
using Grasshopper.Kernel;
using Grasshopper.Kernel.Data;
using Grasshopper.Kernel.Types;
#endregion

public class Script_Instance : GH_ScriptInstance
{
    #region Notes
    /* 
      Members:
        RhinoDoc RhinoDocument
        GH_Document GrasshopperDocument
        IGH_Component Component
        int Iteration

      Methods (Virtual & overridable):
        Print(string text)
        Print(string format, params object[] args)
        Reflect(object obj)
        Reflect(object obj, string method_name)
    */
    #endregion

    private void RunScript(object x, object y, ref object a)
    {
        // Write your logic here
        a = null;
    }
}
# ---------- end c_script ----------
py3 = Python3Script(script=".\demo.py", max_number=Slider(58969, range=10..100000), n_threads=Slider(8, range=0..16))  # -> out, time; unedited script template
panel = Panel(c_script.time)
panel_2 = Panel(py3.time)
panel_3 = Panel(py3.out)
panel_4 = Panel(c_script.out)
